# Dynamo graph CreateFloors.dyn (Dynamo 1.3.0.875)

# note: selected model filled region model elements
select_model_elements = DSModelElementsSelection()  # 2 picked in the model
geometry = Element.Geometry(select_model_elements)
code_block = CodeBlock { 0; }
# note: remove surface first item of index.  Lacing longest for multiple filled regions.  Select lacing shortes for single filled region.
removeItemAtIndex = List.RemoveItemAtIndex(list=geometry, indices=code_block, lacing=Longest)
floor_types = FloorTypes("S12")
categories = Categories("Levels")
all_elements_of_category = ElementsOfCategory(categories)
code_block_2 = CodeBlock { true; }
multiple_floors_on_multiple = Python(IN[0]=removeItemAtIndex, IN[1]=floor_types, IN[2]=all_elements_of_category, IN[3]=code_block_2)  # "multiple floors on multiple levels."
# ---------- multiple_floors_on_multiple.python (46 lines) ----------
import clr
clr.AddReference('ProtoGeometry')
from Autodesk.DesignScript.Geometry import *

clr.AddReference("RevitAPI")
import Autodesk
from Autodesk.Revit.DB import *

clr.AddReference("RevitServices")
import RevitServices 
from RevitServices.Persistence import DocumentManager
from RevitServices.Transactions import TransactionManager

clr.AddReference("RevitNodes")
import Revit
clr.ImportExtensions(Revit.Elements)
clr.ImportExtensions(Revit.GeometryConversion)

doc = DocumentManager.Instance.CurrentDBDocument

ArrayCurves = IN[0]
floorType = UnwrapElement(IN[1])
levels = UnwrapElement(IN[2])
structural = IN[3]

curveList = []
out = []

builtInParam = BuiltInParameter.FLOOR_HEIGHTABOVELEVEL_PARAM

for curve in ArrayCurves:
    curveArray = CurveArray()
    for c in curve:
        curveArray.Append(c.ToRevitType())
    curveList.Add(curveArray)

for l in levels:
    for c in curveList:
        TransactionManager.Instance.EnsureInTransaction(doc)
        newFloor = doc.Create.NewFloor(c, floorType, l, structural)
        p = newFloor.get_Parameter(builtInParam)
        p.Set(0)
        out.Add(newFloor.ToDSType(False))
        TransactionManager.Instance.TransactionTaskDone()

OUT = out
# ----------------------------------------
single_floor = Python()  # unwired: IN[0], IN[1], IN[2], IN[3]
# ---------- single_floor.python (36 lines) ----------
import clr
clr.AddReference('ProtoGeometry')
from Autodesk.DesignScript.Geometry import *

clr.AddReference("RevitAPI")
import Autodesk
from Autodesk.Revit.DB import *

clr.AddReference("RevitServices")
import RevitServices 
from RevitServices.Persistence import DocumentManager
from RevitServices.Transactions import TransactionManager

clr.AddReference("RevitNodes")
import Revit
clr.ImportExtensions(Revit.Elements)
clr.ImportExtensions(Revit.GeometryConversion)

doc = DocumentManager.Instance.CurrentDBDocument

ArrayCurves = IN[0]
floorType = UnwrapElement(IN[1])
levels = UnwrapElement(IN[2])
structural = IN[3]

curveArray = CurveArray()

for c in ArrayCurves:
    curveArray.Append(c.ToRevitType())

TransactionManager.Instance.EnsureInTransaction(doc)
newFloor = doc.Create.NewFloor(curveArray, floorType, levels, structural)
out = newFloor.ToDSType(False)
TransactionManager.Instance.TransactionTaskDone()

OUT = out
# ----------------------------------------
