# Dynamo graph ExcelRead.dyn (Dynamo 1.3.0.875)

file_path = Filename(".\Sheets.xlsx")
python_script = Python(IN[0]=file_path)
# ---------- python_script.python (25 lines) ----------
import clr

clr.AddReference('Microsoft.Office.Interop.Excel, Version=11.0.0.0, Culture=neutral, PublicKeyToken=71e9bce111e9429c')
from Microsoft.Office.Interop import Excel
from System.Runtime.InteropServices import Marshal

path = IN[0]
ex = Excel.ApplicationClass()
ex.Visible = False;
ex.DisplayAlerts = False

workbook = ex.Workbooks.Open(path)
ws = workbook.Worksheets[1]
x1range = ws.Range["A1", "A4"]
x2range = ws.Range["B1", "B4"]

r1 = x1range.Value2
r2 = x2range.Value2

OUT = r1, r2

ex.ActiveWorkbook.Close(False)
Marshal.ReleaseComObject(ws)
Marshal.ReleaseComObject(workbook)
Marshal.ReleaseComObject(ex)
# ----------------------------------------
lastItem = List.LastItem(python_script)
firstItem = List.FirstItem(python_script)
family_types = FamilyTypes("Titleblock E - Standard:SOM-E-Vertical")
python_script_2 = Python(IN[0]=lastItem, IN[1]=firstItem, IN[2]=family_types)
# ---------- python_script_2.python (31 lines) ----------
import clr
clr.AddReference("RevitNodes")
import Revit
clr.ImportExtensions(Revit.Elements)

clr.AddReference("RevitServices")
import RevitServices
clr.AddReference('RevitAPI')
from Autodesk.Revit.DB import *
import Autodesk
import System

from RevitServices.Persistence import DocumentManager
from RevitServices.Transactions import TransactionManager

doc = DocumentManager.Instance.CurrentDBDocument
sheetnames = IN[0]
sheetNumber = IN[1]
titleblock = UnwrapElement(IN[2])
sheetlist = list()

TransactionManager.Instance.EnsureInTransaction(doc)

for number in range(len(sheetNumber)):
    newsheet = ViewSheet.Create(doc, titleblock.Id)
    newsheet.Name = sheetnames[number]
    newsheet.SheetNumber = sheetNumber[number]
    sheetlist.append(newsheet.ToDSType(False))

TransactionManager.Instance.TransactionTaskDone()
OUT = sheetlist
# ----------------------------------------
watch = Watch(python_script_2)
watch_2 = Watch(python_script)
