# Dynamo graph ExcelWrite.dyn (Dynamo 1.3.0.875)

file_path = Filename("F:\00-PROGRAMING - DYNAMO\pyDynamo\pyTest\Sheets.xlsx")
categories = Categories("Sheets")
all_elements_of_category = ElementsOfCategory(categories)
sheetName = Sheet.SheetName(all_elements_of_category)
python_script = Python(IN[0]=file_path, IN[1]=sheetName)
# ---------- python_script.python (29 lines) ----------
import clr

clr.AddReference('Microsoft.Office.Interop.Excel, Version=11.0.0.0, Culture=neutral, PublicKeyToken=71e9bce111e9429c')
from Microsoft.Office.Interop import Excel
from System.Runtime.InteropServices import Marshal
from System import Array

path = IN[0]
# Instantiate the Excel Application
ex = Excel.ApplicationClass()
# Make it Visiable for us all to see
ex.Visible = True
# Disable Alerts - Errors Ignore them, they're probably not important
ex.DisplayAlerts = False
# Workbook 
workbook = ex.Workbooks.Open(path)
# WorkSheet
ws = workbook.Worksheets[1]
# Cell range 
xlrange = ws.Range["A1", "A6"]
sheetName = IN[1]
i = 0
x = len(sheetName)
a = Array.CreateInstance(object, x,1) # rows and column 
while i < len(sheetName):
    a[i,0] = sheetName[i]
    i += 1

xlrange.Value2 = a
# ----------------------------------------
watch = Watch(python_script)
create = List.Create(sheetName)
firstItem = List.FirstItem(create)
