# Dynamo graph FilePathUI.dyn (Dynamo 1.3.0.875)

python_script = Python()  # unwired: IN[0]
# ---------- python_script.python (9 lines) ----------
import clr
clr.AddReference('System.Windows.Forms')
clr.AddReference('System.Drawing')

from System.Drawing import Bitmap
from System.Drawing.Imaging import ImageFormat
from System.Windows.Forms import OpenFileDialog

dialog = OpenFileDialog()
# ----------------------------------------
