# Dynamo graph MYETABSDYNAMO.dyn (Dynamo 1.1.0.2094)

directory_path = Directory("F:\00 - ETABS")
file_path = Filename("SEA%20Etabs\SEA-TAC_SterileCorridor_PartA_20160519.xls")
code_block = CodeBlock { 0; }
etabs_excel_to_revit = Custom[Etabs Excel to Revit](Directory_Path=directory_path, Etabsfile_Path=file_path, X_Move_from_Origin=code_block, Y_Move_from_Origin=code_block, Z_Move_from_Origin=code_block, Rotate_Move_from_Origin=code_block)  # Format Etabs Excel "Joint Coord. Column Conn. Beam Conn. & Framing Assigment Section" to a new Excel file to be used in Dynamo.

# group: REVIT CREATE FRAMING
flatten = Flatten(etabs_excel_to_revit.Beam_Curve)
levels = Levels("Level 2")
structural_framing_types = StructuralFramingTypes("W12X19")
beamByCurve = StructuralFraming.BeamByCurve(curve=flatten, level=levels, structuralFramingType=structural_framing_types)
code_block_2 = CodeBlock { "End Extension"; }
code_block_3 = CodeBlock { 0; }
setParameterByName = Element.SetParameterByName(element=beamByCurve, parameterName=code_block_2, value=code_block_3)
code_block_4 = CodeBlock { "Start Extension"; }
code_block_5 = CodeBlock { 0; }
# note: Extents set to 0.  Without this the roof extents will be off
setParameterByName_2 = Element.SetParameterByName(element=beamByCurve, parameterName=code_block_4, value=code_block_5)

# group: REVIT CREATE COLUMN
levels_2 = Levels("Level 2")
structural_column_types = StructuralColumnTypes("W12X53")
columnByCurve = StructuralFraming.ColumnByCurve(curve=etabs_excel_to_revit.Column_Curve, level=levels_2, structuralColumnType=structural_column_types)
code_block_6 = CodeBlock { "Column Style"; }
code_block_7 = CodeBlock { "Vertical"; }
setParameterByName_3 = Element.SetParameterByName(element=columnByCurve, parameterName=code_block_6, value=code_block_7)
