# Dynamo graph ParameterGet.dyn (Dynamo 1.3.0.875)

categories = Categories("Walls")
all_elements_of_category = ElementsOfCategory(categories)
set_parameter = Python(IN[0]=all_elements_of_category)
# ---------- set_parameter.python (32 lines) ----------
import clr
import sys

clr.AddReference('RevitAPI')
from Autodesk.Revit.DB import *

clr.AddReference('RevitAPIUI')
clr.AddReference('RevitServices')
import RevitServices
from RevitServices.Persistence import DocumentManager
from RevitServices.Transactions import TransactionManager 

clr.AddReference('ProtoGeometry')
from Autodesk.DesignScript.Geometry import *

doc = DocumentManager.Instance.CurrentDBDocument
app = DocumentManager.Instance.CurrentUIApplication.Application

uiapp = DocumentManager.Instance.CurrentUIApplication
app = uiapp.Application

elements = IN[0]


outList = []
familyType = []

for i in UnwrapElement(elements):
    p = i.LookupParameter("APZ Status")
    TransactionManager.Instance.EnsureInTransaction(doc)
    p.Set("Setting a Parameter")
    TransactionManager.Instance.TransactionTaskDone()
# ----------------------------------------
string = StringInput("your paramter name")
get_parameter = Python(IN[0]=all_elements_of_category, IN[1]=string)
# ---------- get_parameter.python (47 lines) ----------
import clr
import sys

clr.AddReference('RevitAPI')
from Autodesk.Revit.DB import *

clr.AddReference('RevitAPIUI')
clr.AddReference('RevitServices')
import RevitServices
from RevitServices.Persistence import DocumentManager
from RevitServices.Transactions import TransactionManager 

clr.AddReference('ProtoGeometry')
from Autodesk.DesignScript.Geometry import *

doc = DocumentManager.Instance.CurrentDBDocument
app = DocumentManager.Instance.CurrentUIApplication.Application

uiapp = DocumentManager.Instance.CurrentUIApplication
app = uiapp.Application

elements = IN[0]
parameter = IN[1]

outList = []
familyType = []

for i in UnwrapElement(elements):
    for j in i.Parameters:
        if j.IsShared and j.Definition.Name == parameter:
            parameterValue = i.get_Parameter(j.GUID)
            outList.append(parameterValue.AsString())

for i in UnwrapElement(IN[0]):
    id = i.GetTypeId()
    if id == ElementId.InvalidElementId:
        familyType.append(None)
    else:
        familyType.append(doc.GetElement(id))

builtInParamType = BuiltInParameter.ALL_MODEL_TYPE_MARK

for i in UnwrapElement(familyType):
    typeMark = i.get_Parameter(builtInParamType)
    outList.append(typeMark.AsString())

OUT = outList
# ----------------------------------------
watch = Watch(get_parameter)
