# Dynamo graph SearchLoop.dyn (Dynamo 1.3.0.875)

categories = Categories("Floors")
all_elements_of_category = ElementsOfCategory(categories)
python_script = Python(IN[0]=all_elements_of_category)
# ---------- python_script.python (28 lines) ----------
import clr
clr.AddReference('ProtoGeometry')
from Autodesk.DesignScript.Geometry import *

clr.AddReference('RevitAPI')
import Autodesk
from Autodesk.Revit.DB import *

clr.AddReference('RevitServices')
import RevitServices
from RevitServices.Persistence import DocumentManager

doc = DocumentManager.Instance.CurrentDBDocument

elements = UnwrapElement(IN[0])

OUTList = []
OUTElements = []

for e in elements:
	x = e.LookupParameter('Workset')
	if x.AsValueString() == 'STRUC':
		OUTList.append(x.AsValueString())
  		OUTElements.append(e)
		
   

OUT = OUTList, OUTElements
# ----------------------------------------
watch = Watch(python_script)
